# Grasshopper definition viewer.gh (Grasshopper 1.0.7)
# plug-ins: AureconGrasshopper

path = FilePath("E:\User Files\Repos\hex-lerp\Hex.Geometry.Tests\rhino\exports\")
files = FilesInDirectory(Directory=path)
getext = GetFileExtension(File=files)  # -> FileName, Extension
mindex = MemberIndex(Set=getext.Extension, Member=".hex")  # -> Index, Count
item = ListItem(List=files, Index=mindex.Index, Wrap=True)
number_slider = Slider(3, range=0..10)
file = ReadFile(File=item, PerLineParse=True)
neg = Negative(Value=number_slider)
split = TextSplit(Text=file, Separators=",")
item_2 = ListItem(List=split, Index=0, Wrap=True)  # -> Item, Item1, Item2, Item3, Item4, Item5
gradient = Gradient(
    LowerLimit=neg,
    UpperLimit=number_slider,
    Parameter=item_2.Item3,
    stops=[0: RGB(234, 38, 0), 0.25: RGB(234, 126, 0), 0.5: RGB(254, 244, 84), 0.75: RGB(173, 203, 249), 1: RGB(75, 107, 169)])
polygon = Polygon(Plane=PlaneXY(0, 0, 0), Radius=Slider(0.6, range=0..1), Segments=6, FilletRadius=0)  # -> Polygon, Length
rotate = Rotate(Geometry=polygon.Polygon, Angle=1.570796327, Plane=PlaneXY(0, 0, 0))  # -> Geometry, Transform
mesh = Mesh(rotate.Geometry)
pt = ConstructPoint(XCoordinate=item_2.Item, YCoordinate=item_2.Item1, ZCoordinate=item_2.Item3)
move = Move(Motion=pt)  # -> Geometry, Transform
image = ImageSampler(
    pt,
    FilePath="C:\Users\Chris\Desktop\flashPerlin.jpg",
    Filter="Value",
    Interpolate=False,
    Umax=70,
    Umin=-70,
    Vmax=70,
    Vmin=-70,
    Wrap=1)
neg_2 = Negative(Value=item_2.Item5)
number_slider_2 = Slider(10, range=0..10)
addition = Addition(A=neg_2, B=Slider(1, range=0..1))
multiplication = Multiplication(A=image, B=addition)
multiplication_2 = Multiplication(A=multiplication, B=Slider(29, range=0..100))
Z = UnitZ(Factor=multiplication_2)
move_2 = Move(Motion=Z)  # -> Geometry, Transform
comp = Compound(Transforms=[move.Transform, move_2.Transform])
transform = Transform(Geometry=mesh, Transform=comp)
mcol = MeshColours(Mesh=transform, Colours=gradient)
mjoin = MeshJoin(Meshes=flatten(mcol))
